# Grasshopper definition example_replayer.gh (Grasshopper 1.0.8)
# plug-ins: RhinoCodePluginGH

panel = Panel("C:\\Users\\localuser\\Documents\\hong-bin\\replayer\\ttool_dataset_new")
acpy_replayer_initializer = AcpyReplayerInitializer(
    i_log_root_path="C:\\Users\\localuser\\Documents\\hong-bin\\replayer\\log",
    i_exp_id="PWB01",
    i_ttool_download_path=panel)  # -> o_replayer, o_frame_count; inputs i_log_root_path: String, i_exp_id: String, i_ttool_download_path: String, i_camera_model: GeometryBase
#   port i_log_root_path: The root path where the log files are stored.
#   port i_exp_id: The experiment id.
#   port i_ttool_download_path: The directory where the TTool models are downloaded.
#   port i_camera_model: Custom camera brep. If not provided, the default camera will be used. The camera brep should facing the positive z-axis.
#   port o_replayer: The initialized replayer object.
#   port o_frame_count: The total number of frames of the loaded log.
# ---------- acpy_replayer_initializer: Python ----------
"""Grasshopper Script Instance"""
import os

import System

import Rhino
import ghpythonlib
from ghpythonlib.componentbase import executingcomponent as component

# FOR DEBUG
import sys
sys.path.append("C:\\Users\\localuser\\Documents\\hong-bin\\replayer\\pypi")

import ACPy
from ACPy.replayer.replayer import Replayer

class ACPyReplayerInitializer(component):
    def __init__(self):
        super(ACPyReplayerInitializer, self).__init__()

    def RunScript(self,
            i_log_root_path: str,
            i_exp_id: str,
            i_ttool_download_path: str,
            i_camera_model: Rhino.Geometry.GeometryBase):
        replayer = Replayer()
        replayer.load(i_log_root_path, i_exp_id, i_ttool_download_path)

        if i_camera_model:
            replayer.set_camera_model(i_camera_model)

        return replayer, replayer.log_data.frame_count
    
# if __name__ == "__main__":
#     replayer, frame_count = ACPyReplayerInitializer().RunScript(log_root_path, exp_id, ttool_download_path, camera_model)
# ---------- end acpy_replayer_initializer ----------
panel_2 = Panel(acpy_replayer_initializer.o_frame_count)

# ----
# Display specific frame directly in Rhino
number_slider = Slider(0, range=0..100000)
acpy_replayer_scene_generator = AcpyReplayerSceneGenerator(i_replayer=acpy_replayer_initializer.o_replayer, i_frame_id=number_slider)  # -> o_camera_model, o_tool_model, o_tool_primitive_model, o_acim_bbox, o_acim_activated_component, o_acim_done_component, o_acim_not_done_component; inputs i_frame_id: Int32
#   port i_replayer: The initialized replayer object.
#   port i_frame_id: The target frame index.
#   port o_camera_model: Transformed camera brep.
#   port o_tool_model: Transformed tool model (Brep).
#   port o_tool_primitive_model: Transformed tool primitve model (Brep).
#   port o_acim_bbox: Transformed acim bounding box.
#   port o_acim_activated_component: Transformed acim activated component.
#   port o_acim_done_component: Transformed acim done component.
#   port o_acim_not_done_component: Transformed acim not done component.
# ---------- acpy_replayer_scene_generator: Python ----------
"""Grasshopper Script Instance"""
import System
import Rhino

import os
import Rhino
import ghpythonlib

import ACPy

class ACPyReplayerSceneGenerator(component):
    def __init__(self):
        super(ACPyReplayerSceneGenerator, self).__init__()

    def RunScript(self, i_replayer, i_frame_id: int):
        scene = i_replayer.generate_scene_at_frame(i_frame_id)

        camera_model = scene["camera_model"]
        tool_model = scene["tool_model"]
        tool_primitive_model = scene["tool_primitive_model"]
        acim_bbox = scene["acim_bbox"]
        acim_activated_component = scene["acim_activated_component"]
        acim_done_component = scene["acim_done_component"]
        acim_not_done_component = scene["acim_not_done_component"]

        return camera_model, tool_model, tool_primitive_model, acim_bbox, acim_activated_component, acim_done_component, acim_not_done_component

# if __name__ == "__main__":
#     camera_model, tool_model, tool_primitive_model, acim_bbox, acim_activated_component, acim_done_component, acim_not_done_component = \
#         ACPyReplayerSceneGenerator().RunScript(i_replayer, i_frame_id)
# ---------- end acpy_replayer_scene_generator ----------

# ----
# Set End Frame
dam = DataDam(DataA=number_slider, BufferDelay=10000000, BufferMode=0)

# ----
# Set Start Frame
dam_2 = DataDam(DataA=number_slider, BufferDelay=10000000, BufferMode=0)

debrep = DeconstructBrep(Brep=acpy_replayer_scene_generator.o_acim_bbox)  # -> Faces, Edges, Vertices
preview = CustomPreview(Geometry=acpy_replayer_scene_generator.o_camera_model, Material=ColourSwatch(SwatchColor=RGBA(0, 85, 204, 74)))
preview_2 = CustomPreview(Geometry=acpy_replayer_scene_generator.o_tool_model, Material=ColourSwatch(SwatchColor=RGB(98, 188, 196)))
preview_3 = CustomPreview(Geometry=debrep.Edges, Material=ColourSwatch(SwatchColor=RGBA(0, 0, 0, 165)))
preview_4 = CustomPreview(
    Geometry=acpy_replayer_scene_generator.o_acim_activated_component,
    Material=ColourSwatch(SwatchColor=RGBA(0, 128, 11, 74)))
preview_5 = CustomPreview(Geometry=acpy_replayer_scene_generator.o_acim_done_component, Material=ColourSwatch(SwatchColor=RGBA(41, 41, 41, 159)))
preview_6 = CustomPreview(
    Geometry=acpy_replayer_scene_generator.o_acim_not_done_component,
    Material=ColourSwatch(SwatchColor=RGBA(0, 40, 128, 74)))

# ----
# Export the video sequence
button = Button()
panel_3 = Panel(dam)
panel_4 = Panel(dam_2)
panel_5 = Panel("C:\\Users\\localuser\\Documents\\hong-bin\\replayer\\output")
acpy_replayer_scene_sequence_generator = AcpyReplayerSceneSequenceGenerator(
    i_replayer=acpy_replayer_initializer.o_replayer,
    i_frame_start=panel_4,
    i_frame_end=panel_3,
    i_run=Toggle(False),
    i_reset=button)  # -> o_frame_idx, o_frame_count, o_camera_model, o_tool_model, o_tool_primitive_model, o_acim_bbox, o_acim_activated_component, o_acim_done_component, o_acim_not_done_component; inputs i_frame_start: Int32, i_frame_end: Int32, i_run: Boolean, i_reset: Boolean
#   port i_replayer: The initialized replayer object.
#   port i_frame_start: The index of the start frame.
#   port i_frame_end: The index of the end frame.
#   port i_run: Regenerate the video sequence.
#   port i_reset: Reset and generate the video sequence.
#   port o_frame_idx: The current frame's index.
#   port o_frame_count: The total amount of the video sequence.
#   port o_camera_model: Transformed camera brep.
#   port o_tool_model: Transformed tool model (Brep).
#   port o_tool_primitive_model: Transformed tool primitve model (Brep).
#   port o_acim_bbox: Transformed acim bounding box.
#   port o_acim_activated_component: Transformed acim activated component.
#   port o_acim_done_component: Transformed acim done component.
#   port o_acim_not_done_component: Transformed acim not done component.
# ---------- acpy_replayer_scene_sequence_generator: Python ----------
"""Generate scene sequence given the start and end frames."""
## FOR DEBUG
# import sys
# sys.path.append("/Users/petingo/p/augmented-carpentry/py/pypi")
import ACPy
from ACPy.replayer.gh_loop import GHLoop

class ACPyReplayerSceneSeqGenerator(component):
    def __init__(self):
        super(ACPyReplayerSceneSeqGenerator, self).__init__()

    def RunScript(self,
            i_replayer,
            i_frame_start: int,
            i_frame_end: int,
            i_run: bool,
            i_reset: bool):
        
        loop = GHLoop(range(i_frame_start, i_frame_end), ghenv)

        if i_reset:
            loop.reset()
            
        if not i_run:
            return None, None, None, None, None, None, None, None, None
    
        frame_idx, frame_absolute_idx = loop.get_next()
        frame_count = len(loop)
        
        scene = i_replayer.generate_scene_at_frame(frame_absolute_idx)

        # object to return
        frame_idx = frame_idx
        frame_count = frame_count
        camera_model = scene["camera_model"]
        tool_model = scene["tool_model"]
        tool_primitive_model = scene["tool_primitive_model"]
        acim_bbox = scene["acim_bbox"]
        acim_activated_component = scene["acim_activated_component"]
        acim_done_component = scene["acim_done_component"]
        acim_not_done_component = scene["acim_not_done_component"]

        return frame_idx, frame_count, camera_model, tool_model, tool_primitive_model, acim_bbox, acim_activated_component, acim_done_component, acim_not_done_component
# ---------- end acpy_replayer_scene_sequence_generator ----------
py3 = Python3Script(exp_id="PWB01", frame_start=panel_4, frame_end=panel_3)  # -> out, output_video_name; inputs exp_id: String, frame_start: String, frame_end: String
# ---------- py3: Python ----------
output_video_name = f"{exp_id}_{frame_start}_{frame_end}"
# ---------- end py3 ----------
panel_6 = Panel(acpy_replayer_scene_sequence_generator.o_frame_idx)
acpy_replayer_video_capturer = AcpyReplayerVideoCapturer(
    i_frame_idx=acpy_replayer_scene_sequence_generator.o_frame_idx,
    i_frame_count=acpy_replayer_scene_sequence_generator.o_frame_count,
    i_frame_rate=Slider(30, range=0..100),
    i_output_path=panel_5,
    i_output_name=py3.output_video_name,
    i_ffmpeg_path="C:\\ffmpeg-7.0.2-full_build\\bin\\ffmpeg",
    i_clean_imgs=Toggle(False))  # disabled
#   port i_frame_idx: The current frame index.
#   port i_frame_count: The total frame count of the sequence.
#   port i_frame_rate: The frame rate of the output video.
#   port i_output_path: The output folder.
#   port i_ffmpeg_path: The path to the ffmpeg executable.
#   port i_clean_imgs: Button to clean the exported frames after generating the video.
# ---------- acpy_replayer_video_capturer: Python ----------
"""Grasshopper Script Instance"""
import subprocess
import os
from glob import glob

import Rhino

## FOR DEBUG
# import sys
# sys.path.append("/Users/petingo/p/augmented-carpentry/py/pypi")

# from ACPy.replayer.capture_img import capture_img

import System
import scriptcontext as sc
import gc
def capture_img(output_path):
    view = sc.doc.Views.ActiveView
    if view:
        view_capture = Rhino.Display.ViewCapture()
        view_capture.Width = view.ActiveViewport.Size.Width
        view_capture.Height = view.ActiveViewport.Size.Height
        view_capture.ScaleScreenItems = False
        view_capture.DrawAxes = False
        view_capture.DrawGrid = False
        view_capture.DrawGridAxes = False
        view_capture.TransparentBackground = False
        bitmap = view_capture.CaptureToBitmap(view)
        if bitmap:
            bitmap.Save(output_path, System.Drawing.Imaging.ImageFormat.Png)
    
    del view
    del view_capture
    del bitmap
    # gc.collect()

import rhinoscriptsyntax as rs

class ACPyReplayerCaptureImg(component):
    def __init__(self):
        super(ACPyReplayerCaptureImg, self).__init__()

    def RunScript(self,
            i_frame_idx,
            i_frame_count,
            i_frame_rate,
            i_output_path,
            i_output_name,
            i_ffmpeg_path,
            i_clean_imgs):
        
        # create folder if not exists
        if not os.path.exists(i_output_path):
            os.makedirs(i_output_path)

        img_output_path = os.path.join(i_output_path, f"frame_{i_frame_idx:06}.png")
        capture_img(img_output_path)
        # cmd = " _Width 1600 _Height 900 _Scale 4 _TransparentBackgroud _Yes _Enter"
        # rs.Command("-ViewCaptureToFile " + img_output_path + cmd)

        if i_frame_idx == i_frame_count - 1:
            glob_pattern = os.path.join(i_output_path, "frame_%06d.png")
            video_output_path = os.path.join(i_output_path, f"{i_output_name}.mp4")

            if i_ffmpeg_path is None or len(i_ffmpeg_path) == 0:
                i_ffmpeg_path = "ffmpeg"
            ffmpeg_command = [i_ffmpeg_path, "-y", "-framerate", str(i_frame_rate), "-i", glob_pattern, "-c:v", "libx264", video_output_path]
            
            result = subprocess.run(ffmpeg_command, stdout=subprocess.PIPE, stderr=subprocess.PIPE)

            if result.returncode != 0:
                Rhino.RhinoApp.WriteLine(f"FFmpeg encounter error while generating video.")
                Rhino.RhinoApp.WriteLine(" ".join(ffmpeg_command))
                Rhino.RhinoApp.WriteLine(result.stdout.decode('utf-8'))
                Rhino.RhinoApp.WriteLine(result.stderr.decode('utf-8'))
                return False
            else:
                if i_clean_imgs:
                    glob_pattern = os.path.join(i_output_path, "frame_*.png")
                    img_files = glob(glob_pattern)
                    for f in img_files:
                        os.remove(f)
                
                return True

# if __name__ == "__main__":
#     ACPyReplayerCaptureImg.RunScript(frame_idx, frame_count, frame_rate, output_path)
# ---------- end acpy_replayer_video_capturer ----------
acpy_replayer_image_cleaner = ImageCleaner(i_path=panel_5, i_run=Button())  # inputs i_path: String, i_run: Boolean
#   port i_path: The folder to clean.
#   port i_run: Set to True to clean the exported frames.
# ---------- acpy_replayer_image_cleaner: Python ----------
"""Grasshopper Script Instance"""
import subprocess
import os
from glob import glob

import Rhino

## FOR DEBUG
# import sys
# sys.path.append("/Users/petingo/p/augmented-carpentry/py/pypi")

from ACPy.replayer.capture_img import capture_img

class ACPyReplayerCaptureImg(component):
    def __init__(self):
        super(ACPyReplayerCaptureImg, self).__init__()

    def RunScript(self,
            i_path,
            i_run):
        
        if i_run:
                glob_pattern = os.path.join(i_path, "frame_*.png")
                img_files = glob(glob_pattern)
                for f in img_files:
                    os.remove(f)

# if __name__ == "__main__":
#     ACPyReplayerCaptureImg.RunScript(frame_idx, frame_count, frame_rate, output_path)
# ---------- end acpy_replayer_image_cleaner ----------

debrep_2 = DeconstructBrep(Brep=acpy_replayer_scene_sequence_generator.o_acim_bbox)  # -> Faces, Edges, Vertices
preview_7 = CustomPreview(Geometry=acpy_replayer_scene_sequence_generator.o_camera_model, Material=ColourSwatch(SwatchColor=RGBA(0, 85, 204, 74)))
preview_8 = CustomPreview(Geometry=acpy_replayer_scene_sequence_generator.o_tool_model, Material=ColourSwatch(SwatchColor=RGB(98, 188, 196)))
preview_9 = CustomPreview(Geometry=debrep_2.Edges, Material=ColourSwatch(SwatchColor=RGBA(0, 0, 0, 165)))
preview_10 = CustomPreview(
    Geometry=acpy_replayer_scene_sequence_generator.o_acim_activated_component,
    Material=ColourSwatch(SwatchColor=RGBA(0, 128, 11, 74)))
preview_11 = CustomPreview(
    Geometry=acpy_replayer_scene_sequence_generator.o_acim_done_component,
    Material=ColourSwatch(SwatchColor=RGBA(41, 41, 41, 159)))
preview_12 = CustomPreview(
    Geometry=acpy_replayer_scene_sequence_generator.o_acim_not_done_component,
    Material=ColourSwatch(SwatchColor=RGBA(0, 40, 128, 74)))
